# Grasshopper definition test-cantilever.gh (Grasshopper 0.9.14)
# plug-ins: SharpFEGrasshopper.Core

M = ElasticMaterial(YoungsModulus=210000, Density=0, PoissonsRatio=0.3, ShearModulus=84000)
gcs = GenericCrossSection(Area=10, Iyy=200000000, Izz=200000, Ixx=50000)
S = NodeSupport(Points=Point(0, 0, 0), UX=True, UY=True, UZ=True, RX=True, RY=True, RZ=True)
B = Beam(Lines=Line((0, 0, 0), (3000, 0, 0)), CrossSection=gcs, Material=M)
L = NodalLoad(Points=Point(3000, 0, 0), Force=Vector(0, 0, -10000), Moment=Vector(0, 0, 0))
A = AssembleModel(Elements=B, Supports=S, Loads=L, ModelType=1)
calc = LinearAnalysis(SharpFEModel=A)
dv = NodeDisplaments(FiniteElementModel=calc)  # -> DisplacementVectors, DisplacedPoints, DisplacedElements
pt = Point(dv.DisplacedPoints)
line = Line(dv.DisplacedElements)
