# Grasshopper definition test-membrane.gh (Grasshopper 0.9.14)
# plug-ins: SharpFEGrasshopper.Core

pt3 = PointXYZ(XComponent=0, YComponent=3000, ZComponent=0, System=PlaneXY(0, 0, 0))
pt2 = PointXYZ(XComponent=3000, YComponent=0, ZComponent=0, System=PlaneXY(0, 0, 0))
pt4 = PointXYZ(XComponent=3000, YComponent=3000, ZComponent=0, System=PlaneXY(0, 0, 0))
pt1 = PointXYZ(XComponent=0, YComponent=0, ZComponent=0, System=PlaneXY(0, 0, 0))
M = ElasticMaterial(YoungsModulus=210000, Density=100, PoissonsRatio=0.3, ShearModulus=1000)
vec = VectorXYZ(XComponent=0, YComponent=0, ZComponent=0)  # -> Vector, Length
vec_2 = VectorXYZ(XComponent=Slider(3808, range=-20000..20000), YComponent=Slider(15600, range=0..100000), ZComponent=0)  # -> Vector, Length
triangle = MeshTriangle(CornerA=1, CornerB=2, CornerC=3)
triangle_2 = MeshTriangle(CornerA=0, CornerB=1, CornerC=2)
L = NodalLoad(Points=pt3, Force=vec_2.Vector, Moment=vec.Vector)
addition = Addition(A=pt3, B=vec_2.Vector)
mesh = Mesh(Vertices=[pt1, pt2, pt3, pt4], Faces=[triangle_2, triangle])
ln = Line(StartPoint=pt3, EndPoint=addition)
S = NodeSupport(Points=[pt3, pt4], UX=False, UY=False, UZ=True, RX=False, RY=False, RZ=False)
S_2 = NodeSupport(Points=[pt2, pt1], UX=True, UY=True, UZ=True, RX=False, RY=False, RZ=False)
T = ConstantStrainTriangle(Mesh=mesh, Material=M, Thickness=100)
A = AssembleModel(Elements=T, Supports=[S, S_2], Loads=L, ModelType=2)
calc = LinearAnalysis(SharpFEModel=A)
dv = NodeDisplaments(FiniteElementModel=calc)  # -> DisplacementVectors, DisplacedPoints, DisplacedElements
